# Dynamo graph Mesh Cleaner.dyn (Dynamo 2.3.0.5885)
# packages: MeshToolkit 3.0.0

# group: Packages
# note: MeshToolkit | v.3.0.0

# group: Annotation
# note: It works thanks to netDxf (https://github.com/haplokuon/netDxf).
# You need to have netDxf.dll file in the same folder of the script.
# dxf files are stored in the Temp folder:
# C:\Users\[UserName]\AppData\Local\Temp\MeshCleaner

# group: Input
# note: Select the right unit for the original mesh
file_path = Filename("..\MODELLO\Base Material\DMod.obj")  # graph input
# note: Select the mesh object. It works with MeshToolkit so obj and mix files are supported
# note: You can reduce the triangle count to get a lighter import. 100 stands for 100% (original quality), 50 is half and so on...
triangles_reduction_100_original = IntegerSlider(10, range=1..100 step 1)  # "% Triangles Reduction (100 = Original quality, 1 = Super Low)"; graph input
import_unit_0_meter_1_decimeter = IntegerSlider(3, range=0..5 step 1)  # "Import Unit (0 = Meter, 1 = Decimeter, 2 = Centimeter, 3 = Millimeter, 4 = Foot, 5 = Inch)"; graph input
# note: You can preview the geometry in the dynamo window. When you're ready you can set import to True and place the mesh in the model
import_geomtetry = BoolSelector(true)  # graph input

code_block = CodeBlock(a=file_path) { a; }
code_block_2 = CodeBlock(a=triangles_reduction_100_original) { a; }
code_block_3 = CodeBlock(a=code_block_2) { a; }
code_block_4 = CodeBlock(a=code_block_3) { a; }

# group: Get the mesh and reduce triangle count if needed
importFile = Autodesk.Dynamo.MeshToolkit.Mesh.ImportFile(fileName=code_block)
firstItem = List.FirstItem(list=importFile)
code_block_5 = CodeBlock(a=firstItem) { a; }
triangleCount = Autodesk.Dynamo.MeshToolkit.Mesh.TriangleCount(mesh=code_block_5)
code_block_6 = CodeBlock(a=triangleCount, x=code_block_4) { a*(x*0.01); }
reduce = Autodesk.Dynamo.MeshToolkit.Mesh.Reduce(mesh=code_block_5, triangleCount=code_block_6)

code_block_7 = CodeBlock(a=firstItem) { a; }

# group: Evaluating placement point based on the original mesh so that you can place in the same spot no matter the triangle cunt reduction
python_script = Python(IN[0]=code_block_7)
# ---------- python_script.python (22 lines) ----------
# Copyright(c) 2018, Dimitar Venkov
# @5devene, dimitar.ven@gmail.com
# www.badmonkeys.net

import clr
clr.AddReference('ProtoGeometry')
from Autodesk.DesignScript.Geometry import BoundingBox, Point, Mesh

def tolist(x):
	if hasattr(x,'__iter__'): return x
	else : return [x]

meshes = tolist(IN[0])
OUT = []

for m in meshes:
	if isinstance(m, Mesh):
		co = zip(*((v.X, v.Y, v.Z) for v in m.VertexPositions))
	else:
		co = zip(*((v.X, v.Y, v.Z) for v in m.Vertices()))

	OUT.append(BoundingBox.ByCorners(Point.ByCoordinates(*map(min, co)), Point.ByCoordinates(*map(max, co))))
# ----------------------------------------
firstItem_2 = List.FirstItem(list=python_script)
minPoint = BoundingBox.MinPoint(boundingBox=firstItem_2)
maxPoint = BoundingBox.MaxPoint(boundingBox=firstItem_2)
X = Point.X(point=maxPoint)
Y = Point.Y(point=maxPoint)
byCoordinates = Point.ByCoordinates(x=X, y=Y)
byStartPointEndPoint = Line.ByStartPointEndPoint(startPoint=minPoint, endPoint=byCoordinates)
code_block_8 = CodeBlock { 0.5; }
pointAtParameter = Curve.PointAtParameter(curve=byStartPointEndPoint, param=code_block_8)
byCoordinates_2 = Point.ByCoordinates()
byTwoPoints = Vector.ByTwoPoints(start=pointAtParameter, end=byCoordinates_2)

# group: moving everything in the right spot
translate = Autodesk.Dynamo.MeshToolkit.Mesh.Translate(mesh=reduce, vector=byTwoPoints)

# group: Extracting faces data for netDxf
vertices = Autodesk.Dynamo.MeshToolkit.Mesh.Vertices(mesh=translate)
X_2 = Point.X(point=vertices)
Y_2 = Point.Y(point=vertices)
Z = Point.Z(point=vertices)
list_create = List.Create(item0=X_2, item1=Y_2, item2=Z)
transpose = List.Transpose(lists=list_create)
vertexIndicesByTri = Autodesk.Dynamo.MeshToolkit.Mesh.VertexIndicesByTri(mesh=translate)
code_block_9 = CodeBlock { 3; }
chop = List.Chop(list=vertexIndicesByTri, lengths=code_block_9)

code_block_10 = CodeBlock { false; }
fileName = FileSystem.FileName(path=code_block, withExtension=code_block_10)
code_block_11 = CodeBlock(a=code_block_4) { a; }
code_block_12 = CodeBlock(a=import_unit_0_meter_1_decimeter, b=import_geomtetry) { a; b; }
code_block_13 = CodeBlock(a=code_block_12.a, b=code_block_12.b) { a; b; }
code_block_14 = CodeBlock(a=code_block_13.a, b=code_block_13.b) { a; b; }

# group: Esporting the dxf file
python_script_2 = Python(IN[0]=transpose, IN[1]=chop, IN[2]=fileName, IN[3]=code_block_11, IN[4]=code_block_14.b)
# ---------- python_script_2.python (55 lines) ----------
import clr
import sys
sys.path.append("C:\Program Files (x86)\IronPython 2.7\Lib")
import os
import System
import System.IO.Directory as DT
import System.IO.Path as PT
import System.Environment
import datetime

clr.AddReference('ProtoGeometry')
from Autodesk.DesignScript.Geometry import *

clr.AddReference("System")
from System.Collections.Generic import List

clr.AddReference('DynamoRevitDS')
import Dynamo 

dynamoRevit = Dynamo.Applications.DynamoRevit()
currentWorkspace = dynamoRevit.RevitDynamoModel.CurrentWorkspace
scriptPath = currentWorkspace.FileName
scriptFolder = PT.GetDirectoryName(scriptPath)

sys.path.append(scriptFolder)
clr.AddReference("netDxf")
import netDxf

verticesCoo = IN[0]
facesVertexIndices = IN[1]
originalFileName = IN[2]
polyReduction = IN[3]
run = IN[4]

timeStamp = datetime.datetime.now().strftime('%Y.%m.%dT%H.%M.%S')
tmpFolder = str(PT.GetTempPath())+"\\MeshCleaner"
DT.CreateDirectory(tmpFolder)
filePath = tmpFolder+"\\"+ originalFileName+"_Quality"+str(polyReduction)+"_"+timeStamp+".dxf"

if run:
	dxfDoc = netDxf.DxfDocument(netDxf.Header.DxfVersion.AutoCad2013)
	
	v3s = []
	for vCoo in verticesCoo:
		v3 = netDxf.Vector3(vCoo[0],vCoo[1],vCoo[2])
		v3s.append(v3)
		
	for fvi in facesVertexIndices:
		face = netDxf.Entities.Face3d(v3s[fvi[0]],v3s[fvi[1]],v3s[fvi[2]])
		face.EdgeFlags = netDxf.Entities.Face3dEdgeFlags.Invisible
		dxfDoc.AddEntity(face)
		
	dxfDoc.Save(filePath)

OUT = filePath
# ----------------------------------------

# group: Placing the dxf import
python_script_3 = Python(IN[0]=python_script_2, IN[1]=code_block_14.a, IN[2]=code_block_14.b)
# ---------- python_script_3.python (33 lines) ----------
import clr

clr.AddReference('RevitAPI')
from Autodesk.Revit.DB import *

clr.AddReference("RevitAPIUI")
from Autodesk.Revit.UI import *

clr.AddReference("RevitServices")
import RevitServices
from RevitServices.Persistence import DocumentManager
from RevitServices.Transactions import TransactionManager

doc = DocumentManager.Instance.CurrentDBDocument

dxfPath = IN[0]
unitIndex = IN[1]
run = IN[2]

unit = [ImportUnit.Meter, ImportUnit.Decimeter, ImportUnit.Centimeter, ImportUnit.Millimeter, ImportUnit.Foot, ImportUnit.Inch]

opts = DWGImportOptions()
opts.AutoCorrectAlmostVHLines = False
opts.Placement = ImportPlacement.Origin
opts.ColorMode = ImportColorMode.Preserved
opts.Unit = unit[unitIndex]

if run:
	TransactionManager.Instance.EnsureInTransaction(doc)
	doc.Import(dxfPath,opts,doc.ActiveView)
	TransactionManager.Instance.TransactionTaskDone()

OUT = None
# ----------------------------------------

code_block_15 = CodeBlock(n=triangleCount) { n+" Triangles. Reduce?"; }
watch = Watch(code_block_15)  # graph output
